# Grasshopper definition 05 Tick Tock Clock Stairs.ghx (Grasshopper 1.0.8)

graft = GraftTree(IncludeEmptyLists=True, IncludeNullItems=True)
panel = Panel("100")
crv = Curve(<curve referenced from the Rhino model>)
offset = OffsetCurve(Curve=graft, Distance="75", Corners=1)
offset_2 = OffsetCurve(Curve=graft, Distance="150", Corners=1)
divlength = DivideLength(Curve=graft, Length="75")  # -> Points, Tangents, Parameters
number_slider = Slider(3000, range=0..10000)
crv_cp = CurveClosestPoint(Point=divlength.Points, Curve=offset)  # -> Point, Parameter, Distance
crv_cp_2 = CurveClosestPoint(Point=divlength.Points, Curve=offset_2)  # -> Point, Parameter, Distance
panel_2 = Panel("""0
1
2
1
0""")
dispatch = Dispatch(List=crv_cp_2.Point, DispatchPattern=[True, False])  # -> ListA, ListB
dom = ConstructDomain(DomainStart="700", DomainEnd="5000")
divlength_2 = DivideLength(Curve=crv, Length=number_slider)  # -> Points, Tangents, Parameters
addition = Addition(A=dispatch.ListA, B=dispatch.ListB)
random = Random(Range=dom, Number="5", Seed=2)
division = Division(A=addition, B="2")
weave = Weave(Pattern=panel_2, Stream0=divlength.Points, Stream1=crv_cp.Point, Stream2=division, NullGaps=False)
division_2 = Division(A=number_slider, B=2)
cir = Circle(Plane=divlength_2.Points, Radius=division_2)
pline = PolyLine(Vertices=weave, Closed=invert(False))
divlength_3 = DivideLength(Curve=crv, Length=random)  # -> Points, Tangents, Parameters
crv_2 = Curve(<curve referenced from the Rhino model>)
curvepoint = PointOnCurve(crv_2, parameter=0)
cir_2 = Circle(Plane=curvepoint, Radius="100")
cir_3 = Circle(Plane=curvepoint, Radius="700")
multiplication = Multiplication(A="9", B="2")
divide = DivideCurve(Curve=cir_2, Count="9", Kinks=False)  # -> Points, Tangents, Parameters
offset_3 = OffsetCurve(Curve=cir_2, Distance="75", Corners=1)
crv_cp_3 = CurveClosestPoint(Point=divide.Points, Curve=offset_3)  # -> Point, Parameter, Distance
division_3 = Division(A="360", B=multiplication)
planar = Planar(Curve=cir_2)  # -> Planar, Plane, Deviation
rotate = Rotate(Geometry=crv_cp_3.Point, Angle=degrees(division_3), Plane=planar.Plane)  # -> Geometry, Transform
panel_3 = Panel("""0
1""")
weave_2 = Weave(Pattern=panel_3, Stream0=divide.Points, Stream1=rotate.Geometry, NullGaps=False)
pline_2 = PolyLine(Vertices=weave_2, Closed=invert(False))
curvepoint_2 = PointOnCurve(crv_2, parameter=0.086)
crv_cp_4 = CurveClosestPoint(Point=curvepoint_2, Curve=cir_2)  # -> Point, Parameter, Distance
cir_4 = Circle(Plane=curvepoint_2, Radius="100")
cir_5 = Circle(Plane=curvepoint_2, Radius=crv_cp_4.Distance)
multiplication_2 = Multiplication(A="9", B="2")
divide_2 = DivideCurve(Curve=cir_4, Count="9", Kinks=False)  # -> Points, Tangents, Parameters
offset_4 = OffsetCurve(Curve=cir_4, Distance="75", Corners=1)
planar_2 = Planar(Curve=cir_4)  # -> Planar, Plane, Deviation
crv_cp_5 = CurveClosestPoint(Point=divide_2.Points, Curve=offset_4)  # -> Point, Parameter, Distance
division_4 = Division(A="360", B=multiplication_2)
rotate_2 = Rotate(Geometry=crv_cp_5.Point, Angle=degrees(division_4), Plane=planar_2.Plane)  # -> Geometry, Transform
panel_4 = Panel("""0
1""")
weave_3 = Weave(Pattern=panel_4, Stream0=divide_2.Points, Stream1=rotate_2.Geometry, NullGaps=False)
pline_3 = PolyLine(Vertices=weave_3, Closed=invert(False))
curvepoint_3 = PointOnCurve(crv_2, parameter=0.201)
crv_cp_6 = CurveClosestPoint(Point=curvepoint_3, Curve=cir_4)  # -> Point, Parameter, Distance
cir_6 = Circle(Plane=curvepoint_3, Radius=crv_cp_6.Distance)
cir_7 = Circle(Plane=curvepoint_3, Radius="100")
multiplication_3 = Multiplication(A="9", B="2")
divide_3 = DivideCurve(Curve=cir_7, Count="9", Kinks=False)  # -> Points, Tangents, Parameters
offset_5 = OffsetCurve(Curve=cir_7, Distance="75", Corners=1)
planar_3 = Planar(Curve=cir_7)  # -> Planar, Plane, Deviation
crv_cp_7 = CurveClosestPoint(Point=divide_3.Points, Curve=offset_5)  # -> Point, Parameter, Distance
division_5 = Division(A="360", B=multiplication_3)
rotate_3 = Rotate(Geometry=crv_cp_7.Point, Angle=degrees(division_5), Plane=planar_3.Plane)  # -> Geometry, Transform
panel_5 = Panel("""0
1""")
weave_4 = Weave(Pattern=panel_5, Stream0=divide_3.Points, Stream1=rotate_3.Geometry, NullGaps=False)
pline_4 = PolyLine(Vertices=weave_4, Closed=invert(False))
curvepoint_4 = PointOnCurve(crv_2, parameter=0.318)
crv_cp_8 = CurveClosestPoint(Point=curvepoint_4, Curve=cir_7)  # -> Point, Parameter, Distance
cir_8 = Circle(Plane=curvepoint_4, Radius=crv_cp_8.Distance)
cir_9 = Circle(Plane=curvepoint_4, Radius="100")
multiplication_4 = Multiplication(A="9", B="2")
divide_4 = DivideCurve(Curve=cir_9, Count="9", Kinks=False)  # -> Points, Tangents, Parameters
offset_6 = OffsetCurve(Curve=cir_9, Distance="75", Corners=1)
planar_4 = Planar(Curve=cir_9)  # -> Planar, Plane, Deviation
crv_cp_9 = CurveClosestPoint(Point=divide_4.Points, Curve=offset_6)  # -> Point, Parameter, Distance
division_6 = Division(A="360", B=multiplication_4)
rotate_4 = Rotate(Geometry=crv_cp_9.Point, Angle=degrees(division_6), Plane=planar_4.Plane)  # -> Geometry, Transform
panel_6 = Panel("""0
1""")
weave_5 = Weave(Pattern=panel_6, Stream0=divide_4.Points, Stream1=rotate_4.Geometry, NullGaps=False)
pline_5 = PolyLine(Vertices=weave_5, Closed=invert(False))
curvepoint_5 = PointOnCurve(crv_2, parameter=0.443)
crv_cp_10 = CurveClosestPoint(Point=curvepoint_5, Curve=cir_9)  # -> Point, Parameter, Distance
cir_10 = Circle(Plane=curvepoint_5, Radius=crv_cp_10.Distance)
graft_2 = GraftTree(Tree=[cir_3, cir_5, cir_6, cir_8, cir_10], IncludeEmptyLists=True, IncludeNullItems=True)
graft_3 = GraftTree(Tree=[cir_3, cir_5, cir_6, cir_8, cir_10], IncludeEmptyLists=True, IncludeNullItems=True)
graft_4 = GraftTree(Tree=[pline_2, pline_3, pline_4, pline_5], IncludeEmptyLists=True, IncludeNullItems=True)
offset_7 = OffsetCurve(Curve=graft_2, Distance=Slider(-250, range=-500..-150), Corners=1)
offset_8 = OffsetCurve(Curve=graft_3, Distance="-150", Corners=1)
offset_9 = OffsetCurve(Curve=graft_3, Distance="-75", Corners=1)
divlength_4 = DivideLength(Curve=graft_3, Length="100")  # -> Points, Tangents, Parameters
mcx = MultipleCurves(Curves=flatten(offset_7))  # -> Points, IndexA, IndexB, ParamA, ParamB
runion = RegionUnion(Curves=flatten(offset_7))
dispatch_2 = Dispatch(List=divlength_4.Points, DispatchPattern=[True, False])  # -> ListA, ListB
crv_cp_11 = CurveClosestPoint(Point=divlength_4.Points, Curve=offset_9)  # -> Point, Parameter, Distance
crv_cp_12 = CurveClosestPoint(Point=divlength_4.Points, Curve=offset_8)  # -> Point, Parameter, Distance
addition_2 = Addition(A=dispatch_2.ListA, B=dispatch_2.ListB)
division_7 = Division(A=addition_2, B="2")
panel_7 = Panel("""2
1
0
1
2""")
weave_6 = Weave(Pattern=panel_7, Stream0=division_7, Stream1=crv_cp_11.Point, Stream2=crv_cp_12.Point, NullGaps=False)
pline_6 = PolyLine(Vertices=weave_6, Closed=invert(False))
lng = ListLength(List=flatten(pline_6))
lng_2 = ListLength(List=flatten(graft_4))
series = Series(Start="0", Step="150", Count=lng)
series_2 = Series(Start="0", Step="150", Count=lng_2)
Z = UnitZ(Factor=series)
Z_2 = UnitZ(Factor=series_2)
move = Move(Geometry=pline_6, Motion=graft(Z))  # -> Geometry, Transform
move_2 = Move(Geometry=graft_4, Motion=graft(Z_2))  # -> Geometry, Transform
multiplication_5 = Multiplication(A="150", B="2")
boundary = BoundarySurfaces(Edges=move.Geometry)
Z_3 = UnitZ(Factor="150")
boundary_2 = BoundarySurfaces(Edges=move_2.Geometry)
Z_4 = UnitZ(Factor=multiplication_5)
extr = Extrude(Base=boundary, Direction=Z_3)
extr_2 = Extrude(Base=boundary_2, Direction=Z_4)
