# Grasshopper definition 10 Dome experiment.ghx (Grasshopper 1.0.8)
# plug-ins: Kangaroo2 Components

pt = Point(<point referenced from the Rhino model>)
number_slider = Slider(4216, range=3000..5000)
number_slider_2 = Slider(10, range=5..20)
number_slider_3 = Slider(10, range=5..20)
xy = XYPlane(Origin=pt)
Z = UnitZ(Factor="-1")
move = Move(Geometry=xy, Motion=Z)  # -> Geometry, Transform
msphere = MeshSphere(Base=xy, Radius=number_slider, UCount=number_slider_2, VCount=number_slider_3)
msplit = MeshSplitPlane(Mesh=msphere, Plane=move.Geometry)  # -> Above, Below
number_slider_4 = Slider(50, range=50..100)
medges = MeshEdges(Mesh=msplit.Above)  # -> NakedEdges, InteriorEdges, NonManifoldEdges
pipe = Pipe(Curve=medges.InteriorEdges, Radius=number_slider_4, Caps=0)
addition = Addition(A=number_slider, B=number_slider_4)
sph = Sphere(Base=xy, Radius=addition)
msphere_2 = MeshSphere(Base=xy, Radius=addition, UCount=number_slider_2, VCount=number_slider_3)
cir = Circle(Plane=xy, Radius=addition)
msplit_2 = MeshSplitPlane(Mesh=msphere_2, Plane=move.Geometry)  # -> Above, Below
srfsplit = SurfaceSplit(Surface=sph, Curves=cir)
number_slider_5 = Slider(100, range=10..200)
item = ListItem(List=srfsplit, Index="0", Wrap=True)
img = ImportImage(File="C:\Users\xlydi\Documents\2024\Studio 1\10 art.png", XSamples=number_slider_5, YSamples=number_slider_5)
faceb = FaceBoundaries(Mesh=msphere_2)

# ---- group: gradually increase this until circles are packed
number_slider_6 = Slider(0.862, range=0..2)

# ----
demesh = DeconstructMesh(Mesh=msplit_2.Above)  # -> Vertices, Faces, Colours, Normals
panel = Panel(demesh.Faces)
N = Count(1700)
crv = Curve(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)
mesh = Mesh(img)
item_2 = ListItem(List=demesh.Faces, Index="0", Wrap=True)
sdivide = DivideSurface(Surface=item, UCount=number_slider_5, VCount=number_slider_5)  # -> Points, Normals, Parameters
pop2d = Populate2D(Region={Plane=PlaneXY(3.176457033, 1.369751357, 0), Size=Domain2(u=0..13.69824552, v=0..7.527864653)}, Count=N, Seed=1)
multiplication = Multiplication(A=Slider(0.02, range=0..1), B=number_slider_6)
multiplication_2 = Multiplication(A=Slider(0.33, range=0..1), B=number_slider_6)
image = ImageSampler(
    sdivide.Parameters,
    FilePath="C:\Users\xlydi\Documents\2024\Studio 1\10 art.png",
    Filter="Colour",
    Interpolate=False,
    Umax=1,
    Umin=0,
    Vmax=1,
    Vmin=0,
    Wrap=1)
imgcircles = ImageCircles(Points=pop2d, Mesh=mesh, Min=multiplication, Max=multiplication_2, Curves=crv, Strength=1)
solver = Solver(GoalObjects=imgcircles, Reset=Button(), Threshold=1e-15, Tolerance=0.01, On=Toggle(True))  # -> I, V, O
cir_2 = Circle(Plane=solver.V, Radius=solver.O)
