# Grasshopper definition 11 Structure.ghx (Grasshopper 1.0.8)
# plug-ins: Pufferfish, Kangaroo2 Components

number_slider = Slider(4000, range=500..5000)
number_slider_2 = Slider(1000, range=500..5000)
number_slider_3 = Slider(2500, range=500..5000)
number_slider_4 = Slider(1500, range=500..5000)
number_slider_5 = Slider(3000, range=500..5000)
pt = Point(<point referenced from the Rhino model>)
pt_2 = Point(<point referenced from the Rhino model>)
pt_3 = Point(<point referenced from the Rhino model>)
pt_4 = Point(<point referenced from the Rhino model>)
pt_5 = Point(<point referenced from the Rhino model>)
xy = XYPlane(Origin=pt)
xy_2 = XYPlane(Origin=pt_2)
xy_3 = XYPlane(Origin=pt_5)
xy_4 = XYPlane(Origin=pt_4)
xy_5 = XYPlane(Origin=pt_3)
sphere = Sphere(Base=xy, Radius=number_slider)
sphere_2 = Sphere(Base=xy_2, Radius=number_slider_4)
sphere_3 = Sphere(Base=xy_3, Radius=number_slider_2)
sphere_4 = Sphere(Base=xy_4, Radius=number_slider_3)
sphere_5 = Sphere(Base=xy_5, Radius=number_slider_5)
graft = GraftTree(Tree=[xy, xy_5, xy_4, xy_3, xy_2], IncludeEmptyLists=True, IncludeNullItems=True)
graft_2 = GraftTree(
    Tree=[number_slider, number_slider_5, number_slider_3, number_slider_2, number_slider_4],
    IncludeEmptyLists=True,
    IncludeNullItems=True)
cir = Circle(Plane=graft, Radius=graft_2)
solid_union = SolidUnion(Breps=[sphere, sphere_5, sphere_4, sphere_3, sphere_2])
runion = RegionUnion(Curves=flatten(cir))
split_brep = SplitBrep(Brep=solid_union, Cutter=runion)
list_item = ListItem(List=split_brep, Index="0", Wrap=True)
qrsettings = QuadRemeshSettings(TargetCount=1000, AdaptiveSize=0, AdaptiveCount=False, HardEdges=False, SeamEdges=0, Symmetry=0, GuideCurves=0)
qrmesh = QuadRemesh(Mesh=list_item, Settings=qrsettings)
medges = MeshEdges(Mesh=qrmesh)  # -> NakedEdges, InteriorEdges, NonManifoldEdges
face_boundaries = FaceBoundaries(Mesh=qrmesh)
number_slider_6 = Slider(20, range=10..100)
pipe = Pipe(Curve=medges.InteriorEdges, Radius=number_slider_6, Caps=0)
addition = Addition(A=number_slider, B=number_slider_6)
panel = Panel("C:\Users\xlydi\OneDrive\Documents\GitHub\Archipunk-Lydia-and-Freya\10 art.png")
offmsh = OffsetMesh(Mesh=qrmesh, Distance=number_slider_6, BothSides=0, CreateSolid=invert(True))
cir_2 = Circle(Plane=xy, Radius=addition)
sph = Sphere(Base=xy, Radius=addition)
srfsplit = SurfaceSplit(Surface=sph, Curves=cir_2)
item = ListItem(List=srfsplit, Index="0", Wrap=True)
crv = Curve(<curve referenced from the Rhino model>)
path = FilePath(panel)
img = ImportImage(File=path, Rectangle=crv)

# ---- group: gradually increase this until circles are packed
number_slider_7 = Slider(1.305, range=0..20)

# ----
N = Count(1700)
mesh = Mesh(img)
pop2d = Populate2D(Region=crv, Count=N, Seed=1)
multiplication = Multiplication(A=Slider(15.185, range=1..100), B=number_slider_7)
multiplication_2 = Multiplication(A=Slider(72.317, range=1..100), B=number_slider_7)
imgcircles = ImageCircles(Points=pop2d, Mesh=mesh, Min=multiplication, Max=multiplication_2, Curves=crv, Strength=1)
solver = Solver(GoalObjects=imgcircles, Reset=Button(), Threshold=1e-15, Tolerance=0.01, On=Toggle(True))  # -> I, V, O
msh2psrf = MeshToPolysurface(Mesh=offmsh, Triangles=False, FaceMerge=False)
Z = UnitZ(Factor=1)
cir_3 = Circle(Plane=solver.V, Radius=solver.O)
neg = Negative(Value=Z)
area = Area(Geometry=cir_3)  # -> Area, Centroid
meshray = MeshRay(Mesh=item, Point=area.Centroid, Direction=neg)  # -> Point, Hit
srf_cp = SurfaceClosestPoint(Point=meshray.Point, Surface=item)  # -> Point, UVPoint, Distance
evalsrf = EvaluateSurface(Surface=item, Point=srf_cp.UVPoint)  # -> Point, Normal, UDirection, VDirection, Frame
xy_6 = XYPlane(Origin=Point(0, 0, 0))
pl_origin = PlaneOrigin(Base=xy_6, Origin=area.Centroid)
orient = Orient(Geometry=cir_3, Source=pl_origin, Target=evalsrf.Frame)  # -> Geometry, Transform
amp = Amplitude(Vector=evalsrf.VDirection, Amplitude=number_slider_6)
pull = PullCurve(Curve=orient.Geometry, Surface=msh2psrf)
vec2pt = Vector2Pt(Unitize=False)  # -> Vector, Length
cap = CapHoles(Brep=item)
sdiff = SolidDifference()
extr = Extrude(Base=graft(orient.Geometry))
extr_2 = ExtrudePoint()
trim = TrimSolid(Shape=cap, Cutters=flatten(pull))
